# Grasshopper definition point cloud.gh (Grasshopper 1.0.7)

ghpython_script = GhPythonScript(x="C:/Users/Dell/Desktop/pointclouds/")  # -> a
# ---------- ghpython_script: Python ----------
__author__ = "Dell"
__version__ = "2023.03.14"

import rhinoscriptsyntax as rs
import os

data_path = "E:/Building Technology/Semester 2/Quarter 3/GEO5017_Machine Learning for the Built Environment/Try 2/GEO5017_Group_13/pointclouds-500/"

file_paths = []

for filename in os.listdir(data_path):
    file_path = data_path + filename
    file_paths.append(file_path)

a = file_paths
# ---------- end ghpython_script ----------
import_coordinates = ImportCoordinates(File=ghpython_script, Separator=" ", XIndex=0, YIndex=1, ZIndex=2)
tree_statistics = TreeStatistics(Tree=import_coordinates)  # -> Paths, Length, Count
number_slider = Slider(100, range=0..100)
split_list = SplitList(List=tree_statistics.Paths, Index=Slider(156, range=101..199))  # -> ListA, ListB
tree_branch = TreeBranch(Tree=import_coordinates, Path=split_list.ListA, MaintainPaths=True)
custom_preview = CustomPreview(
    Geometry=tree_branch,
    Material={diffuse=RGB(221, 160, 221), emission=RGB(66, 48, 66), shine=0.5, specular=RGB(255, 255, 255), transparency=0})
